# Grasshopper definition Passthrough.gh (Grasshopper 1.0.8)
# plug-ins: Pufferfish, Passthrough

# ----
# PASSTHROUGH
# EXPORT SURFACE/MESH TO JSON
panel = Panel("C:\Users\nbarnes\Documents\GitHub\passthrough\exchange\out")
input_surface = Geometry(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)

concat = Concatenate(FragmentA=panel, FragmentB="payload.json", JoinSeparator="\")

panel_2 = Panel("C:\Users\nbarnes\Documents\GitHub\passthrough\exchange\return")

pxexport = PassthroughExport(Surface=input_surface, UCount=24, VCount=Slider(34, range=0..100), Folder=panel, Write=Toggle(False))  # -> Payload, Mesh
pxtrigger = PassthroughTrigger(
    Payload=concat,
    Return=panel_2,
    Command="uv run python scripts\run_roundtrip.py run",
    WorkDir="C:\Users\nbarnes\Documents\GitHub\passthrough",
    Run=Toggle(False))  # -> Launched, Return
pximport = PassthroughImport(Return=panel_2, Pull=Toggle(False))  # -> Mesh, Surface, Range, CollisionPoints, FoldedFaces, DriftMax, CurvatureMax, Status
data = Data(pximport.Mesh)
data_2 = Data(pximport.Surface)
data_3 = Data(pxexport.Mesh)
panel_3 = Panel(pxtrigger.Launched)
panel_4 = Panel(pxexport.Payload)
panel_5 = Panel(pxtrigger.Return)
panel_6 = Panel(pximport.FoldedFaces)
panel_7 = Panel(pximport.CollisionPoints)
panel_8 = Panel(pximport.DriftMax)
panel_9 = Panel(pximport.CurvatureMax)
panel_10 = Panel(pximport.Range)
panel_11 = Panel(data)
panel_12 = Panel(data_2)
panel_13 = Panel(data_3)
panel_14 = Panel(pximport.Status)
merge = Merge(Data1=input_surface, Data2=data_2)
srfstats = SurfaceStatistics(Surface=merge)  # -> FaceCount, UntrimmedFaceCount, TrimmedFaceCount, EdgeCount, VertexCount, ControlPointCount
panel_15 = Panel(srfstats.FaceCount)
panel_16 = Panel(srfstats.TrimmedFaceCount)
panel_17 = Panel(srfstats.UntrimmedFaceCount)
panel_18 = Panel(srfstats.VertexCount)
panel_19 = Panel(srfstats.ControlPointCount)
